# Grasshopper definition swimming fish.gh (Grasshopper 0.9.76)
# plug-ins: Anemone

populate_2d = Populate2D(
    Region={Plane=PlaneXY(0, 0, 0), Size=Domain2(u=0..20, v=0..10)},
    Count=Slider(25, range=0..100),
    Seed=Slider(1234, range=0..10000))

# ----
# Tạo ra "cân nặng" ứng cho từng cá thể
# cá. Mass lớn thì cá bơi nhanh.
number_slider = Slider(1, range=0..1)
list_length = ListLength(List=populate_2d)
construct_domain = ConstructDomain(DomainStart=Slider(1, range=0..1), DomainEnd=number_slider)
random = Random(Range=construct_domain, Number=list_length, Seed=2)

# ----
# Cho hướng đi chính của "đàn cá" lấy
# chiều dài của vector (đã unitize tức bằng
# 1!) nhân cho "trọng lượng ứng của mỗi
# con (con Mass càng lớn thì càng nhanh"
# ra được length của vector rồi định hướng
# lại vector bằng cách * cho vector.
vector = Vector(Vector(0, 0, 1))
unit_vector = UnitVector(Vector=vector)
expression = Expression(Force=unit_vector, Expression="length(Force)")
expression_2 = Expression(x=expression, Mass=random, Expression="x*Mass")
# Minh họa tính ra vector qua component (*)
expression_3 = Expression(x=expression_2, Force=unit_vector, Expression="x*Unitize(Force)")

rep = Slider(50, range=0..1000)
loop_start = LoopStart(Repeat=rep, Trigger=Button(), Data=populate_2d, D1=expression_3)  # -> port, Counter, Data, Data_2

# ---- group: thiết lập vector hàng xóm
# Thiết lập mối quan hệ hàng xóm gần
# nhất 6 con (tức 7 con và bỏ con gần nhất
# tức là chính mình)
number_slider_2 = Slider(7, range=0..10)
closest_points = ClosestPoints(Point=loop_start.Data, Cloud=loop_start.Data, Count=number_slider_2)  # -> ClosestPoint, CPIndex, Distance
cull_index = CullIndex(List=closest_points.ClosestPoint, Indices=Slider(0, range=0..100), Wrap=True)
vector_2pt = Vector2Pt(PointA=graft(loop_start.Data), PointB=cull_index, Unitize=False)  # -> Vector, Length

# ----
# (1)
# (2)
disthres = Slider(6, range=0..10)
unit_vector_2 = UnitVector(Vector=vector_2pt.Vector)

# ---- group: kéo về
# Khi có mối quan hệ ( tức vector từ CON
# CHÍNH ĐẾN CON HÀNG XÓM ) thì:
# Nhân nó cho chỉ số Accel (vector càng
# nhỏ thì nhân ra càng nhỏ nữa, tức chậm
# lại nên là gia tốc)
# (2)
attrachaccel = Slider(0.2, range=0..1)
multiplication = Multiplication(A=vector_2pt.Length, B=attrachaccel)
amplitude = Amplitude(Vector=unit_vector_2, Amplitude=multiplication)

# ----
reverse = Reverse(Vector=unit_vector_2)

# ---- group: đẩy ra
repelaccel = Slider(0.2, range=0..1)
multiplication_2 = Multiplication(A=vector_2pt.Length, B=repelaccel)
amplitude_2 = Amplitude(Vector=reverse, Amplitude=multiplication_2)

# ----
# Mức 2: từ disThres trở ra các con cá được
#  CỘNG thêm 1 giá trị vecto không thay đổi.
# (NHÂN Accel RỒI MỚI CỘNG)
larger_than = LargerThan(FirstNumber=vector_2pt.Length, SecondNumber=disthres)  # -> LargerThan, OrEqualTo
cull_pattern = CullPattern(List=vector_2pt.Vector, CullPattern=larger_than.LargerThan)
# (3)
number_slider_3 = Slider(0.05, range=0..0.1)
unit_vector_3 = UnitVector(Vector=cull_pattern)
amplitude_3 = Amplitude(Vector=unit_vector_3, Amplitude=number_slider_3)

smaller_than = SmallerThan(FirstNumber=vector_2pt.Length, SecondNumber=disthres)  # -> SmallerThan, OrEqualTo
# Khi có cả 2 vector đẩy ra và kéo về
# (Ở đây vector "kéo về thực chất là con
# chính tiến tới con lân cận và ngược lại do
# vector được tạo ra từ con chính đến con
# lân cận). Chúng ta xét đến khoảng cách
# của con chính và lân cận, nếu dưới
# disThres thì con chính tiến tới lân cận còn
#  nếu không thì lùi ra xa con lân cận.
# (3)
pick_n_choose = PickNChoose(Pattern=smaller_than.OrEqualTo, Stream0=amplitude, Stream1=amplitude_2)

globalaccel = Slider(1, range=0..1)
# Vector thúc đẩy mọi vector thêm 1 tí.
vector_length = VectorLength(Vector=loop_start.Data_2)
multiplication_3 = Multiplication(A=vector_length, B=globalaccel)
unit_vector_4 = UnitVector(Vector=loop_start.Data_2)
amplitude_4 = Amplitude(Vector=unit_vector_4, Amplitude=multiplication_3)

# ----
# ((Length(Force)/Mass)*Accel)*Unitize(Force)
# THỰC SỰ KHÔNG HIỂU CHỖ NÀY LẮM
#  Vì Mass được nhân vào lúc đầu nhưng
# thiết lập mối quan hệ thì lại là trong loop.
# Vậy cấu trúc data thay đổi liên tục bên
# trong loop nhưng Mass vẫn giữ nguyên?
# Và việc chia đi vậy thực sự ý nghĩa gì?
mass_addition = MassAddition(Input=[pick_n_choose, amplitude_3])  # -> Result, PartialResults
evaluate = Evaluate(
    Expression="((Length(Force)/Mass)*Accel)*Unitize(Force)",
    Force=flatten(mass_addition.Result),
    Mass=random,
    Accel=Slider(0.01, range=0..0.01))
addition = Addition(A=evaluate, B=amplitude_4)
move = Move(Geometry=loop_start.Data, Motion=addition)  # -> Geometry, Transform
loop_end = LoopEnd(
    port=loop_start.port,
    Exit=False,
    Data=move.Geometry,
    Data_2=addition,
    pausedState=False,
    state="Constant & Record",
    TimeOutVal=0)  # -> Data, D1

# ---- group: Preview
flip_matrix = FlipMatrix(Data=loop_end.Data)
polyline = PolyLine(Vertices=flip_matrix, Closed=False)
end_points = EndPoints(Curve=polyline)  # -> Start, End
point = Point(end_points.End)
